# Grasshopper definition rhino_gh_runner.gh (Grasshopper 1.0.8)

python_3_script = Python3Script(y=Toggle(True))  # -> out, a
# ---------- python_3_script: Python ----------
import sys
import os
import importlib

user_input = x
run_flag = bool(y)

gh_doc = ghenv.Component.OnPingDocument()
gh_file = gh_doc.FilePath

if not gh_file:
    a = None
    log = "Grasshopper file is not saved. Save rhino_gh_runner.gh first."

else:
    grasshopper_dir = os.path.dirname(gh_file)
    repo_path = os.path.dirname(grasshopper_dir)

    if repo_path not in sys.path:
        sys.path.insert(0, repo_path)

    if not run_flag:
        a = None
        log = "Waiting. Set run=True."

    else:
        import gh_loader
        importlib.reload(gh_loader)

        a, log = gh_loader.run_active_tool(user_input)

print(log)
# ---------- end python_3_script ----------
panel = Panel(python_3_script.out)
panel_2 = Panel(python_3_script.a)
